# Grasshopper definition example.gh (Grasshopper 1.0.7)
# plug-ins: THERB-GH

readenvelope = ReadEnvelope(Run=Toggle(True))

# ----
# (壁体構成を編集したい場合)
number_slider = Slider(12, range=0..100)
vec = Vector(Vector(-27.68890331, 14.96975533, 5))
exportt = ExportT(North_direction=vec, Start_month=Slider(1, range=0..1), End_month=number_slider)

# ----
# 1-2.計算に必要な諸条件（北の方角、計算期間）を指定
number_slider_2 = Slider(0.1, range=0..0.1)
# step1. ジオメトリ、条件入力
# 1-1. ジオメトリ情報を入力
brep = Brep([<brep referenced from the Rhino model> x3])
srf = Surface([<surface referenced from the Rhino model> x2])
srf_2 = Surface(<surface referenced from the Rhino model>)

readschedule = ReadSchedule(Run=Toggle(True))
panel = Panel(readschedule)
therb = THERB(Boxes=brep, Windows=srf, Envelope=readenvelope, Tolerance=number_slider_2, fontsize=0)

# ----
# step2. 壁体構成を編集する
# 2-1. 編集するFaceを選択
# 2-2. 壁体構成データを取得
# 2-3. 更新する壁体構成データを選択
decompose = Decompose(Therb=therb)  # -> Rooms, Faces, Windows, Overhangs
filterfacebyproperty = FilterFaceByProperty(Faces=decompose.Faces, Bc=1, SurfT=0, Direction=-1)  # -> TrueFace, FalseFace
readconstruction = ReadConstruction(Run=Toggle(True))
item = ListItem(List=readconstruction, Index=Slider(4, range=0..15), Wrap=True)
panel_2 = Panel(readconstruction)
updateconstruction = UpdateConstruction(Face=filterfacebyproperty.TrueFace, Construction=item)
merge = Merge(Data1=updateconstruction, Data2=filterfacebyproperty.FalseFace)  # -> flatten(Result)
panel_3 = Panel(item)
compose = Compose(Rooms=decompose.Rooms, Faces=merge, Windows=decompose.Windows, Overhangs=decompose.Overhangs)

item_2 = ListItem(List=decompose.Faces, Index=Slider(10, range=0..11), Wrap=True)
readfaceproperty = ReadFaceProperty(Faces=item_2, Type=1, fontsize=30)  # -> RoomId, PartId, Surface, ElementType, Normal, CenterPt, Direction, ConstructionId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
num = Number()
exports = ExportS()

# ----
# step3. 出力をチェック
exportw = ExportW(Construction=readconstruction)
exporta = ExportA(Therb=therb)
exportb = ExportB(Therb=therb)
exportr = ExportR(Therb=therb)

panel_4 = Panel(exportt)
panel_5 = Panel(exports)

b_datファイル書き出し = Panel(exportb)
r_datファイル書き出し = Panel(exportr)
w_datファイル書き出し = Panel(exportw)
panel_6 = Panel(exporta)

item_3 = ListItem(List=readschedule, Index=0, Wrap=True)
exports_2 = ExportS(Schedule=item_3)
panel_7 = Panel(exports_2)

# ----
# step4. 計算開始
run_simulation = RunSimulation(Therb=therb, Constructions=readconstruction, Schedule=item_3, Name="threezone", Cloud=Toggle(False), Run=Toggle(True))

uploadresult = UploadResult()
